% Simulink data dictionary ARFWr_RT.sldd

ActuatorCmdBus = Simulink.Bus()  % ARFWr RT interface bus (T1.3): ActuatorCmdBus
  alphaRW_cmd: double  % Commanded rear-wing angle [deg]
  alphaFW_cmd: double  % Commanded front-wing flap angle [deg]
  stationRW: double  % RW station index, 1..4
  stationFW: double  % FW station index, 1..3
  sOn: double  % Brake-on blend, 0..1

TvCmdBus = Simulink.Bus()  % ARFWr RT interface bus (T1.3): TvCmdBus
  dTq: double  % Torque-vectoring differential torque [Nm] (zero placeholder until T4.2)

ecuTs = Simulink.Parameter(0.01, DataType="double")  % ECU step [s]. DERIVED from ecuLawParams().Ts at sldd creation (T1.3). Owns the model FixedStep and all four ECU Unit Delay sample times. INVARIANT: ecuTs must equal ecuLawParams().Ts -- snapStationRef converts the dwell counter to seconds with law.Ts, so a mismatch silently mis-times the minimum dwell.

DriverCmdBus = Simulink.Bus()  % ARFWr RT interface bus (T2.2): DriverCmdBus -- driver/scenario demand into Plant.slx.
  steer: double  % Front ROAD-WHEEL steer angle [rad], ISO 8855: POSITIVE = LEFT. Same quantity and sign as Scripts/vehModel.m's delta input (peak ~4.5 deg on a solved lap); NOT a hand-wheel angle. Plant.slx negates it internally for the SAE-framed VDB tyre blocks.
  accel: double  % Throttle demand [-], 0..1. Scales the wheel-side tractive torque envelope min(pt.Tmax*vp.gear, pt.Pmax/Om_mean).
  brake: double  % Brake demand [-], 0..1. Maps to Tbrake_applied = -brake*vp.Tbrake_max (SIGNED, <=0).

SensorBus = Simulink.Bus()  % ARFWr RT interface bus (T1.3): SensorBus. Extended T4.2 with kappaRef and TqAxle, the two extra signals the front-axle torque-vectoring allocator needs (simulink/ecu/tvAllocStep.m). Elements 1-4 are unchanged in name, order, type and meaning, so every pre-T4.2 consumer of vx/r/Tbrake/TbMax is unaffected.
  vx: double  % Longitudinal speed [m/s]
  r: double  % Yaw rate [rad/s]
  Tbrake: double  % SIGNED brake torque [Nm], <=0 when braking
  TbMax: double  % Max brake torque magnitude [Nm]
  kappaRef: double  % Reference-path curvature [1/m] at the driver preview point, ISO 8855 sign (> 0 = LEFT turn, same convention as Scripts/vehModel.m:361 "kappa > 0 for left turns"). CONSUMED BY THE TV ALLOCATOR ONLY (simulink/ecu/tvAllocStep.m, yaw-rate target kappaRef*vx); the wing law never reads it. SOURCE: DriverPath's Lap Manager, output 4 negated back from SAE to ISO (DriverPath/KappaRef ISO). The PLANT cannot produce it (it has no path knowledge), so Plant.slx emits 0 on this element and ARFWr_Sim's ECU Sensor Latency substitutes the driver value; ARFWr_Replay feeds a hard 0, which makes the TV allocator a no-op there and leaves gate 5 unchanged.
  TqAxle: double  % Nominal (pre-TV) TOTAL FRONT-AXLE wheel torque [Nm], drive plus brake, signed. Measured in the plant as AxlTrq(FL) + AxlTrq(FR) -- the +/-dTq/2 shift cancels in that sum by construction, so this is the pre-TV quantity tvAllocStep.m's headroom clamp expects, headroom = 2*(perSideCapNm - |TqAxle|/2). SOURCE: Plant/Torque Path AxlTrq, first two rows. ARFWr_Replay feeds 0 (no plant), which only widens the clamp and, with kappaRef = 0 there, changes nothing.

VehStateBus = Simulink.Bus()  % ARFWr RT interface bus (T2.2): VehStateBus -- full plant state out of Plant.slx, ISO 8855 (x fwd, y LEFT, z UP, r>0 = LEFT turn). See add_plant_buses.m header for the SAE<->ISO mirror applied inside Plant.slx.
  vx: double  % Body-frame longitudinal velocity [m/s], + = forward.
  vy: double  % Body-frame lateral velocity [m/s], ISO: + = LEFT.
  r: double  % Yaw rate [rad/s], ISO: + = LEFT turn. Same convention as vehModel.m and simulink/ecu/tvAllocStep.m.
  ax: double  % Body-frame longitudinal specific force (accelerometer reading, gravity excluded) [m/s^2].
  ay: double  % Body-frame lateral specific force [m/s^2], ISO: + = LEFT.
  x: double  % Inertial position, longitudinal [m]. Same planar frame as Functions/curv2cart.m's racing line.
  y: double  % Inertial position, lateral [m], ISO: + = LEFT of the initial heading.
  psi: double  % Heading [rad], ISO: + = counter-clockwise (left) from the initial heading.
  z: double  % Vertical CG displacement from static equilibrium [m], ISO: + = UP.
  roll: double  % Roll angle [rad], ISO: + = LEFT side down.
  pitch: double  % Pitch angle [rad], + = NOSE UP (same sign in both frames -- the mirror is about the x-z plane, which leaves pitch alone).
  RHf: double  % Front ride height [mm]. RHf = vp.RHf0 - 1000*mean(front suspension compression). T3.4 consumes this for the live aeroCollapse ride-height map.
  RHr: double  % Rear ride height [mm]. RHr = vp.RHr0 - 1000*mean(rear suspension compression).
  Om_fl: double  % Front-left wheel spin [rad/s], + = forward rolling.
  Om_fr: double  % Front-right wheel spin [rad/s].
  Om_rl: double  % Rear-left wheel spin [rad/s].
  Om_rr: double  % Rear-right wheel spin [rad/s].
  Fz_fl: double  % Front-left tyre normal load [N], >= 0 (clamped at wheel lift).
  Fz_fr: double  % Front-right tyre normal load [N].
  Fz_rl: double  % Rear-left tyre normal load [N].
  Fz_rr: double  % Rear-right tyre normal load [N].
  Tbrake_applied: double  % Applied brake-torque channel [Nm], SIGNED <= 0 when braking. Identical quantity and sign to Scripts/vehModel.m's T_brake decision variable (its bound is [-vp.Tbrake_max, 0]); total 4-wheel brake torque is 2*Tbrake_applied.
  alphaRW_pos: double  % Rear-wing angle, ACTUATOR POSITION [deg] (post lag/rate/clamp), bound [-10, +15].
  alphaFW_pos: double  % Front-wing flap angle, ACTUATOR POSITION [deg], bound [-25, 0].
  alphaRW_atLim: double  % Rear-wing actuator at a travel/rate limit [0 or 1].
  alphaFW_atLim: double  % Front-wing actuator at a travel/rate limit [0 or 1].
  aeroClF: double  % Front-axle aerodynamic lift coefficient [-] on the fixed reference area vp.A, NEGATIVE = downforce (same sign convention as vp.Cl_front in Scripts/vehModel.m). LIVE: the raw ride-height map interpolated at the instantaneous (RHf,RHr) plus the rear- and front-wing node-delta blends at the live actuator angles.
  aeroClR: double  % Rear-axle aerodynamic lift coefficient [-], same convention as aeroClF.
  aeroCd: double  % Total drag coefficient [-] = vp.Cd0 + (dCdA_RW(alphaRW) + dCdA_FW(alphaFW))/vp.A.
  aeroClamp: double  % Aero input-clamp diagnostic, a bit code (0 = nothing clamped): +1 front ride height outside the map grid, +2 rear ride height outside it, +4 rear-wing angle outside the map node range, +8 front-wing angle outside it. The ride-height bits are EXPECTED to be set for much of a fast lap -- Functions/aeroCollapse.m clamps to the same grid edges and reports its own clamp onset from 66 m/s at the Mid wing state -- so this is a diagnostic, not an error flag. The wing bits should never set: the actuators already clamp to act.rwClamp/act.fwClamp.
  Fy_fl: double  % Lateral tyre force at the front left corner [N], ISO 8855 (+ = LEFT), as the plant's own tyre law computed it. Published T4.2 (review fix I2) so consumers can form a MEASURED per-axle lateral force instead of assuming the static l_r/l : l_f/l split of m*ay -- that assumption is wrong exactly where it matters, because lateral load transfer and the front/rear aero balance move the real split away from the static one. Mirrored from the SAE body-frame FyB inside busAssemble, the single place the SAE->ISO flip happens.
  Fy_fr: double  % Lateral tyre force at the front right corner [N], ISO 8855 (+ = LEFT), as the plant's own tyre law computed it. Published T4.2 (review fix I2) so consumers can form a MEASURED per-axle lateral force instead of assuming the static l_r/l : l_f/l split of m*ay -- that assumption is wrong exactly where it matters, because lateral load transfer and the front/rear aero balance move the real split away from the static one. Mirrored from the SAE body-frame FyB inside busAssemble, the single place the SAE->ISO flip happens.
  Fy_rl: double  % Lateral tyre force at the rear left corner [N], ISO 8855 (+ = LEFT), as the plant's own tyre law computed it. Published T4.2 (review fix I2) so consumers can form a MEASURED per-axle lateral force instead of assuming the static l_r/l : l_f/l split of m*ay -- that assumption is wrong exactly where it matters, because lateral load transfer and the front/rear aero balance move the real split away from the static one. Mirrored from the SAE body-frame FyB inside busAssemble, the single place the SAE->ISO flip happens.
  Fy_rr: double  % Lateral tyre force at the rear right corner [N], ISO 8855 (+ = LEFT), as the plant's own tyre law computed it. Published T4.2 (review fix I2) so consumers can form a MEASURED per-axle lateral force instead of assuming the static l_r/l : l_f/l split of m*ay -- that assumption is wrong exactly where it matters, because lateral load transfer and the front/rear aero balance move the real split away from the static one. Mirrored from the SAE body-frame FyB inside busAssemble, the single place the SAE->ISO flip happens.